# Dynamo graph Level Copy.dyn (Dynamo 2.13.1.3887)

levels = Levels("1st Floor")
all_elements_at_level = ElementsAtLevel(Level=levels)
target_levels = CodeBlock()
# ---------- target_levels.designscript (7 lines) ----------
levels = [
	"694", // 2nd Floor
	"1345358", // 5th Floor
	"1345666", // 4th Floor
	"1345676", // Roof Deck
	"1345678" // 3rd Floor
];
# ----------------------------------------
target_levels_get = Python(IN[0]=target_levels)  # CPython3
# ---------- target_levels_get.python (53 lines) ----------
import clr
import math
from io import StringIO

import Autodesk
import RevitServices
from Autodesk.Revit.DB import *
from Autodesk.Revit.DB import FilteredElementCollector, Dimension

from RevitServices.Persistence import DocumentManager
from RevitServices.Transactions import TransactionManager
from Autodesk.Revit.DB import Dimension, Line, XYZ

clr.AddReference("RevitAPI")
clr.AddReference("RevitServices")


# For Outputting print to watch node
output = StringIO()
sys.stdout = output
result = []
doc = DocumentManager.Instance.CurrentDBDocument

def transaction(func):
    def wrapper(*args, **kwargs):
            TransactionManager.Instance.EnsureInTransaction(doc)
            func(*args, **kwargs)
            TransactionManager.Instance.TransactionTaskDone()
    return wrapper
 
def print_member(obj):
  for i in dir(obj):
      print(i)

@transaction
def start():
  target_levels = UnwrapElement(IN[0])

  # Get all levels in the document
  collector = FilteredElementCollector(doc).OfClass(Level)
  levels = collector.ToElements()

  # Create a list of level names
  for level in levels:
      lvl_name = level.Name
      lvl_id = level.Id.ToString()
      if lvl_id in target_levels:
        result.append(level)


start()

OUT = result
# ----------------------------------------
watch = Watch(target_levels_get)
python_script = Python(IN[0]=all_elements_at_level, IN[1]=watch)  # CPython3
# ---------- python_script.python (86 lines) ----------
import clr
import math
from io import StringIO

import Autodesk
import RevitServices
from Autodesk.Revit.DB import *
from Autodesk.Revit.DB import FilteredElementCollector, Dimension, ElementTransformUtils

from RevitServices.Persistence import DocumentManager
from RevitServices.Transactions import TransactionManager
from Autodesk.Revit.DB import Dimension, Line, XYZ



clr.AddReference("RevitAPI")
clr.AddReference("RevitServices")


# For Outputting print to watch node
output = StringIO()
sys.stdout = output

doc = DocumentManager.Instance.CurrentDBDocument

def transaction(func):
    def wrapper(*args, **kwargs):
            TransactionManager.Instance.EnsureInTransaction(doc)
            func(*args, **kwargs)
            TransactionManager.Instance.TransactionTaskDone()
    return wrapper
 
def print_member(obj):
  for i in dir(obj):
      print(i)

@transaction 
def start():
  target_levels = UnwrapElement(IN[1])
  t_level = target_levels[0]
  print(t_level.Id)
  
  # Fliter Groups
  elements = UnwrapElement(IN[0])
  group = []
  for e in elements:
    if isinstance(e, Group):
      group.append(e)
   
   
  # Iterate through groups
  for grp in group:
    grp_elements = grp.GetMemberIds()
    elems = [doc.GetElement(e) for e in grp_elements]
    for e in elems:
      transform = e.Location.Point
      elementId = e.Id
      # params = e.GetParameters()
      # print(params)
      # print(elementId)
      

      copied_id = ElementTransformUtils.CopyElement(doc, elementId, transform)
      copied_instance = doc.GetElement(copied_id[0])
      print(copied_id[0])
      schedule_level = copied_instance.GetParameters("Schedule Level")[0]
      elevation_level = copied_instance.GetParameters("Elevation from Level")[0]
      
      print(schedule_level.AsString())
      print(elevation_level.AsString())
      schedule_level.Set(t_level.Id)
      elevation_level.SetValueString("1000mm")

      # print(copied_instance)
      # Element.SetParameterByName(copied_instance, "Schedule Level", t_level)

      # copied_instance.Level = t_level

      break
    break

  # print(target_levels)

start()

OUT = output.getvalue()
# ----------------------------------------
watch_2 = Watch(python_script)
level_printer = Python()  # CPython3; unwired: IN[0]
# ---------- level_printer.python (53 lines) ----------
import clr
import math
from io import StringIO

import Autodesk
import RevitServices
from Autodesk.Revit.DB import *
from Autodesk.Revit.DB import FilteredElementCollector, Dimension

from RevitServices.Persistence import DocumentManager
from RevitServices.Transactions import TransactionManager
from Autodesk.Revit.DB import Dimension, Line, XYZ

clr.AddReference("RevitAPI")
clr.AddReference("RevitServices")


# For Outputting print to watch node
output = StringIO()
sys.stdout = output

doc = DocumentManager.Instance.CurrentDBDocument

def transaction(func):
    def wrapper(*args, **kwargs):
            TransactionManager.Instance.EnsureInTransaction(doc)
            func(*args, **kwargs)
            TransactionManager.Instance.TransactionTaskDone()
    return wrapper
 
def print_member(obj):
  for i in dir(obj):
      print(i)


def  level_printer():
  # Get all levels in the document
  collector = FilteredElementCollector(doc).OfClass(Level)
  levels = collector.ToElements()

  for level in levels:
      lvl_name = level.Name
      lvl_id = level.Id.ToString()
      print(f'"{lvl_id}" # {lvl_name}, ')


@transaction
def start():
  level_printer()

start()

OUT = output.getvalue()
# ----------------------------------------
watch_3 = Watch(level_printer)
